# Grasshopper definition intro_simple building.gh (Grasshopper 1.0.7)
# plug-ins: Bifocals

number_slider = Slider(4.89, range=0..10)
curve = Curve(<curve referenced from the Rhino model>)
进深 = Slider(12.775, range=-10..100)
param_viewer = ParamViewer(curve)
panel = Panel(curve)
unit_z = UnitZ(Factor=1)
evaluate_length = EvaluateLength(Curve=curve, Length=Slider(0.374, range=0..1), Normalized=True)  # -> Point, Tangent, Parameter
division = Division(A=进深, B="2")
negative = Negative(Value=division)
# 柱axis
number_slider_2 = Slider(0.162, range=0..1)
vector_display = VectorDisplay(Anchor=evaluate_length.Point, Vector=evaluate_length.Tangent)
addition = Addition(A=number_slider, B=Slider(2.549, range=0..10))
unit_z_2 = UnitZ(Factor=1)
entwine = Entwine(Branch00=division, Branch01=negative, FlattenInputs=True)
line_sdl = LineSDL(Start=evaluate_length.Point, Direction=evaluate_length.Tangent, Length=Slider(22.27, range=0..100))
offset = Offset(Curve=line_sdl, Distance=entwine, Plane=PlaneXY(0, 0, 0), Corners=1)
panel_2 = Panel(line_sdl)
end_points = EndPoints(Curve=offset)  # -> Start, End
divide_curve = DivideCurve(Curve=offset, Count=Slider(3, range=0..10), Kinks=False)  # -> Points, Tangents, Parameters
point = Point(divide_curve.Points)
line_sdl_2 = LineSDL(Start=point, Direction=unit_z, Length=number_slider)
evaluate_length_2 = EvaluateLength(Curve=line_sdl_2, Length=Slider(1, range=0..1), Normalized=True)  # -> Point, Tangent, Parameter
pipe = Pipe(Curve=line_sdl_2, Radius=number_slider_2, Caps=0)
polyline = PolyLine(Vertices=evaluate_length_2.Point, Closed=False)
cap_holes = CapHoles(Brep=pipe)
end_points_2 = EndPoints(Curve=polyline)  # -> Start, End
flatten_tree = FlattenTree(Tree=polyline, Path="{0}")
entwine_2 = Entwine(Branch00=end_points.Start, Branch01=end_points.End, FlattenInputs=True)
entwine_3 = Entwine(Branch00=end_points_2.Start, Branch01=end_points_2.End, FlattenInputs=True)
polyline_2 = PolyLine(Vertices=entwine_3, Closed=False)
polyline_3 = PolyLine(Vertices=entwine_2, Closed=False)
curve_2 = Curve(polyline_3)
evaluate_length_3 = EvaluateLength(Curve=curve_2, Length=Slider(0.5, range=0..1), Normalized=True)  # -> Point, Tangent, Parameter
line_sdl_3 = LineSDL(Start=evaluate_length_3.Point, Direction=unit_z_2, Length=addition)
evaluate_length_4 = EvaluateLength(Curve=line_sdl_3, Length=Slider(1, range=0..1), Normalized=True)  # -> flatten(Point), Tangent, Parameter
polyline_4 = PolyLine(Vertices=evaluate_length_4.Point, Closed=False)
insert_items = InsertItems(List=flatten_tree, Item=polyline_4, Indices=expr("1", 1), Wrap=True)

divide_curve_2 = DivideCurve(Curve=insert_items, Count=Slider(9, range=0..30), Kinks=False)  # -> Points, Tangents, Parameters
flip_matrix = FlipMatrix(Data=divide_curve_2.Points)
number_slider_3 = Slider(1.72, range=0..10)
polyline_5 = PolyLine(Vertices=flip_matrix, Closed=False)
extend_curve = ExtendCurve(Curve=polyline_5, Type=0, Start=number_slider_3, End=number_slider_3)  # -> flatten(Curve)
number_slider_4 = Slider(0.09, range=0..1)
number_slider_5 = Slider(0.192, range=0..1)
evaluate_length_5 = EvaluateLength(Curve=extend_curve, Length=Slider(0, range=0..1), Normalized=True)  # -> Point, Tangent, Parameter
construct_domain = ConstructDomain(DomainStart=number_slider_4, DomainEnd=expr("-x", number_slider_4))
construct_domain_2 = ConstructDomain(DomainStart=number_slider_5, DomainEnd=expr("-x", number_slider_5))
curve_frame = CurveFrame(Curve=extend_curve, Parameter=evaluate_length_5.Parameter)
deconstruct_plane = DeconstructPlane(Plane=curve_frame)  # -> Origin, XAxis, YAxis, ZAxis
plane_normal = PlaneNormal(Origin=evaluate_length_5.Point, ZAxis=deconstruct_plane.XAxis)
rectangle = Rectangle(Plane=plane_normal, XSize=construct_domain, YSize=construct_domain_2, Radius=0)  # -> Rectangle, Length
vector_display_ex = VectorDisplayEx(Point=evaluate_length_5.Point, Vector=deconstruct_plane.XAxis, Colour=RGB(0, 0, 0), Width=2)
curve_3 = Curve(extend_curve)
graft_tree = GraftTree(Tree=rectangle.Rectangle, IncludeEmptyLists=True, IncludeNullItems=True)
sweep1 = Sweep1(Rail=graft(curve_3), Sections=graft(rectangle.Rectangle), Miter=1)
cap_holes_2 = CapHoles(Brep=sweep1)

flatten_tree_2 = FlattenTree(Tree=divide_curve.Points, Path="{0}")
list_item = ListItem(List=flatten_tree_2, Index=Slider(0, range=0..10), Wrap=True)
deconstruct = Deconstruct(Point=flatten_tree_2)  # -> XComponent, YComponent, ZComponent
deconstruct_2 = Deconstruct(Point=list_item)  # -> XComponent, YComponent, ZComponent
graft_tree_2 = GraftTree(Tree=flatten_tree_2, IncludeEmptyLists=True, IncludeNullItems=True)
entwine_4 = Entwine(Branch00=deconstruct.XComponent, Branch01=deconstruct.YComponent, Branch02=deconstruct.ZComponent, FlattenInputs=True)
entwine_5 = Entwine(
    Branch00=deconstruct_2.XComponent,
    Branch01=deconstruct_2.YComponent,
    Branch02=deconstruct_2.ZComponent,
    FlattenInputs=True)
subtraction = Subtraction(A=entwine_4, B=entwine_5)
flip_matrix_2 = FlipMatrix(Data=subtraction)
numbers_to_points = NumbersToPoints(Numbers=flip_matrix_2, Mask=4)
text_tag_3d = TextTag3D(Location=graft_tree_2, Text=numbers_to_points, Size=Slider(0.287, range=0..1), Justification=7)

number_slider_6 = Slider(1.88, range=0..10)
extend_curve_2 = ExtendCurve(Curve=insert_items, Type=0, Start=number_slider_6, End=number_slider_6)
loft_options = LoftOptions(Closed=False, Adjust=False, Rebuild=0, Refit=0, Type=3)
simplify_curve = SimplifyCurve(Curve=extend_curve_2)  # -> Curve, Simplified
control_points = ControlPoints(Curve=simplify_curve.Curve)  # -> Points, Weights, Knots
polyline_6 = PolyLine(Vertices=control_points.Points, Closed=False)  # -> flatten(Polyline)
loft = Loft(Curves=polyline_6, Options=loft_options)
